# Grasshopper definition agents.gh (Grasshopper 1.0.7)
# plug-ins: SurfaceTrails2

# ----
# Following Path
crv = Curve(<curve referenced from the Rhino model>)

# ----
# Terrain as a Brep
data = Data(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)

mesh_brep = MeshBrep(
    Brep=data,
    Settings={GridMaxCount=0, GridMinCount=16, JaggedSeams=False, MaxEdgeLength=0, MinEdgeLength=0.0001, MinTolerance=0, Refine=True, RefineAngle=0, RelativeTolerance=0.65, SimplePlanes=True, Tolerance=0})

brep = Brep(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)
box = Box(brep)
mesh = Mesh(mesh_brep)

end = EndPoints(Curve=crv)  # -> Start, End
number_slider = Slider(1, range=0..10)
vec2pt = Vector2Pt(PointA=end.Start, PointB=end.End, Unitize=False)  # -> Vector, Length

reset = Button()
clear = Button()

project = Project(Curve=crv, Brep=data, Direction=Vector(0, 0, 1))
number_slider_2 = Slider(0, range=0..1)
number_slider_3 = Slider(59, range=0..1000)
Z = UnitZ(Factor=Slider(10, range=0..10))
move = Move(Geometry=project, Motion=Z)  # -> Geometry, Transform
number_slider_4 = Slider(10, range=0..100)
pframe = PerpFrame(Curve=reparameterize(move.Geometry), Parameter=number_slider_2)
cir = Circle(Plane=pframe, Radius=number_slider_4)
pipe = Pipe(Curve=move.Geometry, Radius=number_slider_4, Caps=0)

eval = EvaluateCurve(Curve=reparameterize(project), Parameter=number_slider_2)  # -> Point, Tangent, Angle
eval_2 = EvaluateCurve(Curve=reparameterize(move.Geometry), Parameter=number_slider_2)  # -> Point, Tangent, Angle
eval_3 = EvaluateCurve(Curve=reparameterize(project), Parameter=1)  # -> Point, Tangent, Angle
xy = XYPlane(Origin=eval_2.Point)
xy_2 = XYPlane(Origin=eval_3.Point)
cir_2 = Circle(Plane=xy, Radius=number_slider_4)
boundary = BoundarySurfaces(Edges=cir_2)
boundary_2 = BoundarySurfaces(Edges=cir)

popgeo = PopulateGeometry(Geometry=boundary, Count=number_slider_3, Seed=1)
popgeo_2 = PopulateGeometry(Geometry=boundary_2, Count=number_slider_3, Seed=1)
project_2 = ProjectPoint(Point=popgeo, Direction=Vector(0, 0, -1), Geometry=data)  # -> Point, Index

cir_3 = Circle(Plane=xy_2, Radius=number_slider_4)
pt = Point(project_2.Point)
pt_2 = Point(project_2.Point)

# ---- group: Agent Parameters
number_slider_5 = Slider(0, range=0..10)
number_slider_6 = Slider(2, range=0..10)
flock_agent_2d = FlockAgent2D(MinimumVelocity=number_slider_5, MaximumVelocity=number_slider_6, StartPointForAgent=pt)
flockagent3d = FlockAgent3D(MinimumVelocity=number_slider_5, MaximumVelocity=number_slider_6, StartPointForAgent=pt_2)
fprops = FlockProperties(
    Timestep=Slider(0.05, range=0..1),
    NeighbourhoodRadius=Slider(0.9, range=0..5),
    Alignment=Slider(0.23, range=0..1),
    Cohesion=Slider(30.62, range=0..100),
    Separation=Slider(13.92, range=0..100),
    SeparationDistance=Slider(0.6, range=0.01..5))

# ---- group: Containers
boxcontainment = BoxContainment(Box=box, Multiplier=Slider(10, range=0..10))
brepcontainment = BrepContainment(Brep=pipe, Multiplier=Slider(100, range=0..100))
meshcontainment = MeshContainment(Mesh=mesh, Multiplier=3)

# ---- group: Behaviours
nickname = WindBehaviour(Vector=vec2pt.Vector, Multiplier=number_slider)
attract = AttractingBehaviour(Circles=cir_3, AttractToNearestPoint=Toggle(True), Multiplier=number_slider)

# ----
engine = FlockingEngine(
    UseParallel=True,
    UseRTree=True,
    Reset=reset,
    Play=Toggle(False),
    Agents=flockagent3d,
    FlockProperties=fprops,
    Behaviours=attract,
    Containment=meshcontainment)  # -> Positions, Velocities

# ---- group: Display
resettablerecorder = ResettableDataRecorder(Data=engine.Positions, Reset=reset, Clear=clear)
amp = Amplitude(Vector=engine.Velocities, Amplitude=Slider(0.01, range=0..0.01))
pline = PolyLine(Vertices=resettablerecorder, Closed=False)
vdis = VectorDisplay(Anchor=engine.Positions, Vector=amp)
