# Grasshopper definition Particle_Spring_Example.gh (Grasshopper 1.0.7)
# plug-ins: Kangaroo2 Components, Bifocals

# ----
# Turn this on to see the names of the components -->
# HereThere's a internalized Circle curve -->
circle = Data(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)

panel = Panel("0.2")
# Here you prepare the geometry
scale = Scale(Geometry=circle, Center=Point(0, 0, 0), Factor="1")  # -> Geometry, Transform
boundary = BoundarySurfaces(Edges=scale.Geometry)
divide = DivideCurve(Curve=scale.Geometry, Count=50, Kinks=False)  # -> simplify(Points), Tangents, Parameters
popgeo = PopulateGeometry(Geometry=boundary, Count=500, Seed=1)
del = DelaunayMesh(Points=[divide.Points, popgeo], Plane=PlaneXY(0, 0, 0))
medges = MeshEdges(Mesh=del)  # -> NakedEdges, InteriorEdges, NonManifoldEdges

# ----
# Here you prepare the simulation components
data = Data([medges.InteriorEdges, medges.NakedEdges])
Z = UnitZ(Factor=1)
len = Length(Curve=data)
rev = Reverse(Vector=Z)
edgelengths = EdgeLengths(Mesh=del, LengthFactor=0, Strength=100)
anchor = Anchor(Point=flatten(divide.Points), Strength=10000)
pressure = Pressure(M=del, Strength=0.12)  # disabled
length_line = LengthLine(Line=data, Length=len, Strength=100)
load = Load(Point=popgeo, ForceVector=Z, Weighting=10000)
show = Show(G=del)
entwine = Entwine(
    Branch00=anchor,
    Branch01=length_line,
    Branch02=load,
    Branch03=show,
    Branch04=edgelengths,
    Branch05=pressure,
    FlattenInputs=True)  # -> flatten(Result)

# ----
# Here you run the simulation
button = Button()
bouncysolver = BouncySolver(
    GoalObjects=flatten(entwine),
    Reset=button,
    Threshold=1e-15,
    Tolerance=0.0001,
    Damping=0.99,
    Iterations=10,
    On=Toggle(False))  # -> I, V, O

division = Division(A=Slider(10, range=0..10), B=Slider(3, range=0..10))
scale_2 = Scale(Geometry=bouncysolver.O, Center=Point(0, 0, 0), Factor=division)  # -> Geometry, Transform
