# Grasshopper definition Organic_pattern.gh (Grasshopper 1.0.7)
# plug-ins: Shortest Walk in Gh, Kangaroo2 Components, MarchingCubes, Weaverbird

# ----
# Here you can control the point-->>
md_slider = MDSlider(
    SliderMode=0,
    slider_value=Point(0.0306979795, 0.4907455444, 0.5),
    x_domain=Domain(0, 1),
    y_domain=Domain(0, 1),
    z_domain=Domain(0, 1))
# HereThere's a internalized Surface -->
data = Data(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)
evalsrf = EvaluateSurface(Surface=reparameterize(data), Point=md_slider)  # -> Point, Normal, UDirection, VDirection, Frame
popgeo = PopulateGeometry(Geometry=data, Count=100, Seed=1)
data_2 = Data(flatten(popgeo))
prox = Proximity3D(Points=flatten(data_2), Group=15)  # -> flatten(Links), Topology
ln = Line(StartPoint=popgeo, EndPoint=evalsrf.Point)
dom = ConstructDomain(DomainStart=0.5, DomainEnd=1)
range = Range(Domain=dom, Steps=Slider(5, range=0..10))  # -> reverse(Range)
graph = GraphMapper(
    range,
    x0=0.5,
    x1=1,
    y0=0.5,
    y1=1,
    container_name="Bezier",
    cpx=[0, 0.2447488904, 0.6265583038, 1],
    cpy=[0, 0.8936731219, 0.7348015904, 0])
dom_2 = ConstructDomain(DomainStart=0.5, DomainEnd=2)
remap = RemapNumbers(Value=graph, Source=dom, Target=dom_2)  # -> Mapped, Clipped
material = CreateMaterial(
    Diffuse=ColourSwatch(SwatchColor=RGB(243, 164, 255)),
    Specular=RGB(255, 255, 255),
    Emission=RGB(0, 0, 0),
    Transparency=0,
    Shine=0)

dupln = RemoveDuplicateLines(Lines=prox.Links, Tolerance=0.01)

shortwalk = ShortestWalk(Curves=dupln, WantedPath=ln)  # -> ShortestWalk, simplify(Succession), Direction, Length
explode = Explode(Curve=shortwalk.ShortestWalk, Recursive=True)  # -> flatten(Segments), Vertices
dupln_2 = RemoveDuplicateLines(Lines=explode.Segments, Tolerance=0.01)
join = JoinCurves(Curves=dupln_2, Preserve=False)
disc = Discontinuity(Curve=join, Level=1)  # -> simplify(Points), Parameters
intcrv = Interpolate(Vertices=disc.Points, Degree=3, Periodic=False, KnotStyle=1)  # -> Curve, Length, Domain
curve_charge = CurveCharge(Curve=flatten(intcrv.Curve), Radius=Slider(1.85, range=0..10), ChargeStrengths=remap.Mapped)  # disabled
cocoon = Cocoon(
    Charges=curve_charge,
    Iso=Slider(0.02, range=0..4),
    CellSize=Slider(2.23, range=0..9),
    Execute=Toggle(True),
    Simple=False)  # -> Mesh, RefinementData
refine = Refine(
    RefinementData=cocoon.RefinementData,
    Samples=Slider(2, range=0..100),
    SampleSize="0.2",
    SampleTolerance="0.001",
    LaplacianSmoothing="1",
    ValencePasses="1",
    SubD="1",
    Execute=Toggle(True))
wbloop = WeaverbirdsLoopSubdivision(MeshCurves=cocoon.Mesh, Level=3, SmoothNakedEdges=1)
wbcatmullclark = WeaverbirdsCatmullClarkSubdivision(MeshCurves=refine, Level=1, SmoothNakedEdges=1)
# <<--Here you can see your geometry
preview = CustomPreview(Geometry=wbloop, Material=material)  # disabled
